# Grasshopper definition from_route_to_line_chart.gh (Grasshopper 1.0.8)
# plug-ins: Heron

path = FilePath()
file = ReadFile(File=path, PerLineParse=True)
cull_i = CullIndex(List=file, Indices="0", Wrap=True)
panel = Panel(file)
split = TextSplit(Text="51.52265912188006, -0.004117167427758242", Separators=",")
tab = Panel(",")
panel_2 = Panel(split)
split_2 = TextSplit(Text=cull_i, Separators=tab)
panel_3 = Panel(split_2)
item = ListItem(List=panel_2, Index="0", Wrap=True)  # -> Item, Item1
item_2 = ListItem(List=split_2, Index="0", Wrap=True)  # -> Item, Item1, Item2
item_3 = ListItem(List=split_2, Index="0", Wrap=True)  # -> Item, Item1, Item2, Item3
item_4 = ListItem(List=split_2, Index="0", Wrap=True)  # -> Item, Item1, Item2, Item3, Item4
item_5 = ListItem(List=split_2, Index="0", Wrap=True)  # -> Item, Item1, Item2, Item3, Item4, Item5
panel_4 = Panel(item.Item1)
panel_5 = Panel(item.Item)
item_6 = ListItem(List=split_2, Index="0", Wrap=True)  # -> Item, Item1, Item2, Item3, Item4, Item5, Item6
radians = Radians(Degrees=item_2.Item2)
radians_2 = Radians(Degrees=item_3.Item2)
radians_3 = Radians(Degrees=item_4.Item2)
multiplication = Multiplication(A=item_2.Item1, B="111320")
multiplication_2 = Multiplication(A=item_3.Item1, B="111320")
multiplication_3 = Multiplication(A=item_4.Item1, B="111320")
radians_4 = Radians(Degrees=item_5.Item2)
radians_5 = Radians(Degrees=item_6.Item2)
multiplication_4 = Multiplication(A=item_5.Item1, B="111320")
multiplication_5 = Multiplication(A=item_6.Item1, B="111320")
cosine = Cosine(Value=radians_2)
cosine_2 = Cosine(Value=radians)
seteap = SetEarthAnchorPoint(SetEAP=Toggle(True), Latitude=panel_5, Longitude=panel_4)
cosine_3 = Cosine(Value=radians_3)
cosine_4 = Cosine(Value=radians_4)
multiplication_6 = Multiplication(A=item_3.Item3, B=Slider(2, range=1..5))
multiplication_7 = Multiplication(A=item_4.Item4, B=Slider(4, range=1..5))
cosine_5 = Cosine(Value=radians_5)
multiplication_8 = Multiplication(A=item_2.Item2, B="111320")
multiplication_9 = Multiplication(A=multiplication, B=cosine_2)
multiplication_10 = Multiplication(A=item_3.Item2, B="111320")
multiplication_11 = Multiplication(A=multiplication_2, B=cosine)
multiplication_12 = Multiplication(A=item_5.Item5, B=Slider(100, range=1..300))
multiplication_13 = Multiplication(A=item_4.Item2, B="111320")
multiplication_14 = Multiplication(A=multiplication_3, B=cosine_3)
multiplication_15 = Multiplication(A=item_6.Item6, B=Slider(0.05, range=0.01..1))
multiplication_16 = Multiplication(A=item_5.Item2, B="111320")
multiplication_17 = Multiplication(A=multiplication_4, B=cosine_4)
multiplication_18 = Multiplication(A=item_6.Item2, B="111320")
multiplication_19 = Multiplication(A=multiplication_5, B=cosine_5)
list_item = ListItem(List=item_2.Item, Index=0, Wrap=True)  # -> flatten(Item)
pt = ConstructPoint(XCoordinate=multiplication_9, YCoordinate=multiplication_8, ZCoordinate=0)  # -> flatten(Point)
pt_2 = ConstructPoint(XCoordinate=multiplication_11, YCoordinate=multiplication_10, ZCoordinate=multiplication_6)  # -> flatten(Point)
list_item_2 = ListItem(List=item_3.Item, Index=0, Wrap=True)  # -> flatten(Item)
pt_3 = ConstructPoint(XCoordinate=multiplication_14, YCoordinate=multiplication_13, ZCoordinate=multiplication_7)  # -> flatten(Point)
list_item_3 = ListItem(List=item_4.Item, Index=0, Wrap=True)  # -> flatten(Item)
pt_4 = ConstructPoint(XCoordinate=multiplication_17, YCoordinate=multiplication_16, ZCoordinate=multiplication_12)  # -> flatten(Point)
list_item_4 = ListItem(List=item_5.Item, Index=0, Wrap=True)  # -> flatten(Item)
pt_5 = ConstructPoint(XCoordinate=multiplication_19, YCoordinate=multiplication_18, ZCoordinate=multiplication_15)  # -> flatten(Point)
list_item_5 = ListItem(List=item_6.Item, Index=0, Wrap=True)  # -> flatten(Item)
path_2 = FilePath("C:\Users\37462\Desktop\new part\地铁.csv")  # disabled
sort_list = SortList(Keys=list_item, ValuesValuesA=pt)  # -> Keys, flatten(ValuesValuesA)
sort_list_2 = SortList(Keys=list_item_2, ValuesValuesA=pt_2)  # -> Keys, flatten(ValuesValuesA)
sort_list_3 = SortList(Keys=list_item_3, ValuesValuesA=pt_3)  # -> Keys, flatten(ValuesValuesA)
file_2 = ReadFile(File=path_2, PerLineParse=True)  # disabled
sort_list_4 = SortList(Keys=list_item_4, ValuesValuesA=pt_4)  # -> Keys, flatten(ValuesValuesA)
panel_6 = Panel("0")  # disabled
sort_list_5 = SortList(Keys=list_item_5, ValuesValuesA=pt_5)  # -> Keys, flatten(ValuesValuesA)
cull_i_2 = CullIndex(List=file_2, Indices=panel_6, Wrap=True)  # disabled
panel_7 = Panel(file_2)  # disabled
tab_2 = Panel(",")  # disabled
interpolate = Interpolate(Vertices=flatten(sort_list.ValuesValuesA), Degree=Slider(1, range=1..3), Periodic=False, KnotStyle=Slider(2, range=0..2))  # -> Curve, Length, Domain
interpolate_2 = Interpolate(
    Vertices=flatten(sort_list_2.ValuesValuesA),
    Degree=Slider(1, range=1..3),
    Periodic=False,
    KnotStyle=Slider(2, range=0..2))  # -> Curve, Length, Domain
point_list = PointList(Points=sort_list.ValuesValuesA)  # disabled
interpolate_3 = Interpolate(
    Vertices=flatten(sort_list_3.ValuesValuesA),
    Degree=Slider(1, range=1..3),
    Periodic=False,
    KnotStyle=Slider(2, range=0..2))  # -> Curve, Length, Domain
point_list_2 = PointList(Points=sort_list_2.ValuesValuesA)  # disabled
point_list_3 = PointList(Points=sort_list_3.ValuesValuesA)  # disabled
interpolate_4 = Interpolate(
    Vertices=flatten(sort_list_4.ValuesValuesA),
    Degree=Slider(1, range=1..3),
    Periodic=False,
    KnotStyle=Slider(2, range=0..2))  # -> Curve, Length, Domain
point_list_4 = PointList(Points=sort_list_4.ValuesValuesA)  # disabled
split_3 = TextSplit(Text=cull_i_2, Separators=tab_2)  # disabled
interpolate_5 = Interpolate(
    Vertices=flatten(sort_list_5.ValuesValuesA),
    Degree=Slider(1, range=1..3),
    Periodic=False,
    KnotStyle=Slider(2, range=0..2))  # -> Curve, Length, Domain
point_list_5 = PointList(Points=sort_list_5.ValuesValuesA)  # disabled
gradient = Gradient(LowerLimit=0, UpperLimit=1, Parameter=interpolate.Domain, stops=[0: RGB(255, 130, 160), 0.85: RGB(220, 0, 40)])
panel_8 = Panel("0")  # disabled
gradient_2 = Gradient(LowerLimit=0, UpperLimit=1, Parameter=interpolate_2.Domain, stops=[0: RGB(255, 130, 160), 0.85: RGB(220, 0, 40)])
panel_9 = Panel(split_3)  # disabled
gradient_3 = Gradient(LowerLimit=0, UpperLimit=1, Parameter=interpolate_3.Domain, stops=[0: RGB(255, 130, 160), 0.85: RGB(220, 0, 40)])
gradient_4 = Gradient(LowerLimit=0, UpperLimit=1, Parameter=interpolate_5.Domain, stops=[0: RGB(255, 130, 160), 0.85: RGB(220, 0, 40)])
gradient_5 = Gradient(LowerLimit=0, UpperLimit=1, Parameter=interpolate_4.Domain, stops=[0: RGB(255, 130, 160), 0.85: RGB(220, 0, 40)])
item_7 = ListItem(List=split_3, Index=panel_8, Wrap=True)  # -> Item, Item1, Item2; disabled
panel_10 = Panel("111320")  # disabled
custom_preview = CustomPreview(Geometry=interpolate_2.Curve, Material=gradient_2)
custom_preview_2 = CustomPreview(Geometry=interpolate.Curve, Material=gradient)
custom_preview_3 = CustomPreview(Geometry=interpolate_3.Curve, Material=gradient_3)
radians_6 = Radians(Degrees=item_7.Item2)  # disabled
custom_preview_4 = CustomPreview(Geometry=interpolate_5.Curve, Material=gradient_4)
custom_preview_5 = CustomPreview(Geometry=interpolate_4.Curve, Material=gradient_5)
multiplication_20 = Multiplication(A=item_7.Item1, B=panel_10)  # disabled
cosine_6 = Cosine(Value=radians_6)  # disabled
panel_11 = Panel("111320")  # disabled
multiplication_21 = Multiplication(A=item_7.Item2, B=panel_11)  # disabled
multiplication_22 = Multiplication(A=multiplication_20, B=cosine_6)  # disabled
list_item_6 = ListItem(List=item_7.Item, Index=0, Wrap=True)  # -> flatten(Item); disabled
pt_6 = ConstructPoint(XCoordinate=multiplication_22, YCoordinate=multiplication_21, ZCoordinate=0)  # -> flatten(Point); disabled
sort_list_6 = SortList(Keys=list_item_6, ValuesValuesA=pt_6)  # -> Keys, flatten(ValuesValuesA); disabled
number_slider = Slider(1, range=1..3)  # disabled
number_slider_2 = Slider(2, range=0..2)  # disabled
interpolate_6 = Interpolate(Vertices=flatten(sort_list_6.ValuesValuesA), Degree=number_slider, Periodic=False, KnotStyle=number_slider_2)  # -> Curve, Length, Domain; disabled
point_list_6 = PointList(Points=sort_list_6.ValuesValuesA)  # disabled
gradient_6 = Gradient(LowerLimit=0, UpperLimit=1, Parameter=interpolate_6.Domain, stops=[0: RGB(255, 130, 160), 0.85: RGB(220, 0, 40)])  # disabled
custom_preview_6 = CustomPreview(Geometry=interpolate_6.Curve, Material=gradient_6)  # disabled
