# Grasshopper definition Contour Distribution Map.gh (Grasshopper 1.0.8)
# plug-ins: Human, Heron

# ---- group: Input
x = Panel("13")  # disabled
y = Panel("9")  # disabled
geo = Geometry([<point referenced from the Rhino model> x1236])  # disabled

# ----
panel = Panel("1000")  # disabled
geo_2 = Geometry(<curve referenced from the Rhino model>)  # disabled

# ---- group: Inclusion
sqgrid = Square(Plane=geo_2, Size=panel, ExtentX=x, ExtentY=y)  # -> flatten(Cells), Points; disabled
area = Area(Geometry=sqgrid.Cells)  # -> Area, Centroid; disabled
merge = Merge(Data1=geo, Data2=area.Centroid)  # disabled
pt = Point(merge)  # disabled
incurves = PointInCurves(Point=pt, Curves=sqgrid.Cells)  # -> Relationship, Index, Point; disabled
python = GhPythonScript(numbers=incurves.Index)  # -> out, simplify(a); inputs numbers: list of Int32; disabled
# ---------- python: Python ----------
import ghpythonlib.treehelpers as th

index_dict = {}
for index, number in enumerate(numbers):
    if number not in index_dict:
        index_dict[number] = []
    index_dict[number].append(index)

# Ensure all numbers from 0 to max(numbers) are included
max_number = max(numbers)
sorted_index_lists = [index_dict.get(i, []) for i in range(max_number + 1)]

from pprint import pprint
pprint(sorted_index_lists)
pprint(index_dict)





a = th.list_to_tree(sorted_index_lists)
# ---------- end python ----------
tstat = TreeStatistics(Tree=python.a)  # -> Paths, Length, Count; disabled

# ----
panel_2 = Panel("30")  # disabled
split = TextSplit(Text="41.39016863804901, 2.161895385119639", Separators=",")
points = PointList(Points=area.Centroid, Size=panel_2)  # disabled
panel_3 = Panel(split)
panel_4 = Panel("0.5")  # disabled
points_2 = PointList(Points=merge, Size=panel_4)  # disabled
item = ListItem(List=panel_3, Index="0", Wrap=True)  # -> Item, Item1
panel_5 = Panel(incurves.Index)  # disabled
panel_6 = Panel(item.Item)
panel_7 = Panel(item.Item1)
panel_8 = Panel(python.a)  # disabled
panel_9 = Panel("111320")  # disabled
panel_10 = Panel("111320")  # disabled

# ---- group: Surface Grid
panel_11 = Panel("0")  # disabled
panel_12 = Panel("200")  # disabled
# Add contrast by "streching" the numbers
bnd = Bounds(Numbers=tstat.Length)  # disabled
dom = ConstructDomain(DomainStart=panel_11, DomainEnd=panel_12)  # disabled
remap = RemapNumbers(Value=tstat.Length, Source=bnd, Target=dom)  # -> Mapped, Clipped; disabled
Z = UnitZ(Factor=remap.Mapped)  # disabled
move = Move(Geometry=area.Centroid, Motion=Z)  # -> Geometry, Transform; disabled
srfgrid = SurfaceFromPoints(Points=move.Geometry, UCount=x, Interpolate=False)  # disabled

# ----
seteap = SetEarthAnchorPoint(SetEAP=Toggle(True), Latitude=panel_6, Longitude=panel_7)
panel_13 = Panel("0")  # disabled
panel_14 = Panel(bnd)  # disabled

# ---- group: Graphics & Baking
number_slider = Slider(1, range=0..2)  # disabled
contour = Contour(Shape=srfgrid, Point=Point(0, 0, 0), Direction=Vector(0, 0, 1), Distance=number_slider)  # disabled
eval = EvaluateCurve(Curve=contour, Parameter=0)  # -> Point, Tangent, Angle; disabled
pdecon = Deconstruct(Point=eval.Point)  # -> XComponent, YComponent, ZComponent; disabled
bnd_2 = Bounds(Numbers=flatten(pdecon.ZComponent))  # disabled
dedomain = DeconstructDomain(Domain=bnd_2)  # -> Start, End; disabled
gradient = Gradient(
    LowerLimit=dedomain.Start,
    UpperLimit=dedomain.End,
    Parameter=flatten(pdecon.ZComponent),
    stops=[0: RGB(180, 234, 153), 0: RGB(152, 190, 208), 0: RGB(0, 229, 238), 0.00314: RGB(173, 203, 249), 0.0046: RGB(64, 0, 64), 0.33: RGB(75, 107, 169), 0.657: RGB(153, 50, 204), 1: RGB(219, 112, 147), 1: RGB(234, 117, 94), 1: RGB(178, 34, 34), 1: RGB(234, 126, 0)])  # disabled
panel_15 = Panel("Contours")  # disabled
preview = CustomPreview(Geometry=flatten(contour), Material=gradient)  # disabled
button = Button()  # disabled
createatts = CreateAttributes(LayerName=panel_15, Color=gradient, enableFullPath=False)  # disabled
bake = BakeGeometry(Bake=button, Geometry=flatten(contour), Attributes=createatts, DeleteOldBakes=False, PreserveTrees=False)  # disabled

# ----
path = FilePath("C:\Users\37462\Desktop\Skills Modules Submission\module3\flickr_latlon_for_gh.csv")  # disabled
file = ReadFile(File=path, PerLineParse=True)  # disabled
panel_16 = Panel("0")  # disabled
cull_i = CullIndex(List=file, Indices=panel_16, Wrap=True)  # disabled
panel_17 = Panel(file)  # disabled
tab = Panel(",")  # disabled
split_2 = TextSplit(Text=cull_i, Separators=tab)  # disabled
panel_18 = Panel(split_2)  # disabled
panel_19 = Panel("0")  # disabled
item_2 = ListItem(List=split_2, Index=panel_19, Wrap=True)  # -> Item, Item1; disabled

radians = Radians(Degrees=item_2.Item)  # disabled
multiplication = Multiplication(A=item_2.Item, B=panel_9)  # disabled
multiplication_2 = Multiplication(A=item_2.Item1, B=panel_10)  # disabled
cosine = Cosine(Value=radians)  # disabled
multiplication_3 = Multiplication(A=multiplication_2, B=cosine)  # disabled

pt_2 = ConstructPoint(XCoordinate=multiplication_3, YCoordinate=multiplication, ZCoordinate=panel_13)  # disabled
